# Grasshopper definition Evacuation.gh (Grasshopper 1.0.9)

number_slider = Slider(10, range=0..100)  # disabled
number_slider_2 = Slider(4, range=0..10)  # disabled
number_slider_3 = Slider(1.5, range=0..10)  # disabled
toggle = BooleanToggle(True)  # disabled
button = Button()  # disabled
crv = Curve([<curve referenced from the Rhino model> x3])
crv_2 = Curve(<curve referenced from the Rhino model>)  # disabled
crv_3 = Curve(<curve referenced from the Rhino model>)  # disabled
crv_4 = Curve(<curve referenced from the Rhino model>)  # disabled
path = FilePath("C:\Users\robin\OneDrive - University College London\AC\Final Thesis\corner.sqlite")  # disabled
path_2 = FilePath("C:\Users\robin\OneDrive - University College London\AC\Final Thesis\corner.sqlite")
trigger = Trigger(Interval=1, TimerInterval=5, Target=py3)  # disabled
crv_5 = Curve(<curve referenced from the Rhino model>)
crv_6 = Curve([<curve referenced from the Rhino model> x4])
crv_7 = Curve([<curve referenced from the Rhino model> x2])
trigger_2 = Trigger(Interval=1, TimerInterval=5, Target=py3_2)  # disabled
py3 = Python3Script(
    run=toggle,
    reset=button,
    boundary_crv=crv_2,
    start_crv=crv_3,
    exit_crv=crv_4,
    num_agents=number_slider,
    trajectory_file_path=path,
    mean_speed=number_slider_2,
    speed_std=number_slider_3)  # -> out, Area_Geo, Agent_Geo, sim_active; inputs run: Boolean, reset: Boolean, boundary_crv: Curve, obstacles_crvs: list of Curve, start_crv: Curve, exit_crv: Curve, num_agents: Int32, trajectory_file_path: String, mean_speed: Double, speed_std: Double; disabled
# ---------- py3: Python ----------
# -*- coding: utf-8 -*-
# Final, robust script for trigger-based simulation in Grasshopper

import scriptcontext as sc
import Rhino.Geometry as rg
from shapely.geometry import Polygon
import jupedsim as jps
from numpy.random import normal
import pathlib

# ==============================================================================
# Helper Functions
# ==============================================================================

def curve_to_polygon(crv):
    """Converts a closed Rhino Curve to a shapely Polygon."""
    if not crv or not crv.IsClosed: return None
    res, polyline = crv.TryGetPolyline()
    if not res: return None
    return Polygon([(pt.X, pt.Y) for pt in polyline])

def poly_to_rhino_surface(polygon):
    """Converts a shapely Polygon (with potential holes) to Rhino Breps."""
    if not polygon: return None
    outer_crv = rg.Polyline([rg.Point3d(x, y, 0) for x, y in polygon.exterior.coords]).ToNurbsCurve()
    inner_crvs = [rg.Polyline([rg.Point3d(x, y, 0) for x, y in interior.coords]).ToNurbsCurve() for interior in polygon.interiors]
    breps = rg.Brep.CreatePlanarBreps([outer_crv] + inner_crvs, 0.01)
    return list(breps) if breps else []

# ==============================================================================
# Main Script Logic
# ==============================================================================

# --- Handle Reset ---
# This has priority and will clear the simulation state.
if reset and 'sim_instance' in sc.sticky:
    sc.sticky.pop('sim_instance')
    print("Simulation Reset.")

# --- Handle Initialization ---
# This runs only once when 'run' is True and no simulation exists.
if run and 'sim_instance' not in sc.sticky:
    print("Initializing simulation...")
    
    # Input validation
    if all([boundary_crv, start_crv, exit_crv, trajectory_file_path]):
        # Geometry conversion
        area = curve_to_polygon(boundary_crv)
        spawning_area = curve_to_polygon(start_crv)
        exit_area = curve_to_polygon(exit_crv)
        
        if all([area, spawning_area, exit_area]):
            # Simulation setup
            traj_path = pathlib.Path(trajectory_file_path)
            traj_path.parent.mkdir(parents=True, exist_ok=True)
            model = jps.SocialForceModel()
            
            simulation = jps.Simulation(
                model=model, geometry=area,
                trajectory_writer=jps.SqliteTrajectoryWriter(output_file=traj_path)
            )
            
            # Define journey and create agents
            exit_id = simulation.add_exit_stage(exit_area.exterior.coords[:-1])
            journey_id = simulation.add_journey(jps.JourneyDescription([exit_id]))
            positions = jps.distributions.distribute_by_number(
                polygon=spawning_area, number_of_agents=num_agents,
                distance_to_agents=0.4, distance_to_polygon=0.2, seed=1
            )
            speeds = normal(mean_speed, speed_std, num_agents)

            #parameter
            for pos, v0 in zip(positions, speeds):
                simulation.add_agent(
                        jps.SocialForceModelAgentParameters(
                        journey_id=journey_id, stage_id=exit_id,
                        position=pos, desired_speed=v0,
                    )
                )
            
            sc.sticky['sim_instance'] = simulation
            print("Initialization complete.")

# --- Initialize outputs for this run ---
Agent_Geo = []
sim_active = False
out = "Idle."

# --- Main simulation and output logic ---
simulation = sc.sticky.get('sim_instance')

if simulation:
    if simulation.agent_count() > 0:
        if run:
            simulation.iterate()
        
        agents = simulation.agents()
        Agent_Geo = [rg.Point3d(agent.position[0], agent.position[1], 0) for agent in agents]
        
        status = "Running" if run else "Paused"
        out = "{} | Step: {} | Agents: {}".format(status, simulation.iteration_count(), simulation.agent_count())
        sim_active = True
        
        if run and simulation.agent_count() == 0:
            out = "Simulation Complete! | Steps: {}".format(simulation.iteration_count())
            sim_active = False
            sc.sticky.pop('sim_instance')
    else:
        out = "Simulation Complete! Press 'reset' to start over."
        sim_active = False
        if 'sim_instance' in sc.sticky:
            sc.sticky.pop('sim_instance')
else:
    out = "Ready. Set 'run' to True to initialize."
    
# --- Always prepare visualization geometry for output ---
Area_Geo = []
area_srf = poly_to_rhino_surface(curve_to_polygon(boundary_crv))
start_srf = poly_to_rhino_surface(curve_to_polygon(start_crv))
exit_srf = poly_to_rhino_surface(curve_to_polygon(exit_crv))
if area_srf: Area_Geo.extend(area_srf)
if start_srf: Area_Geo.extend(start_srf)
if exit_srf: Area_Geo.extend(exit_srf)
# ---------- end py3 ----------
py3_2 = Python3Script(
    run=Toggle(True),
    reset=Button(),
    boundary_crv=crv_5,
    obstacles_crvs=crv,
    start_crvs=crv_6,
    exit_crvs=crv_7,
    num_agents=Slider(18, range=0..100),
    trajectory_file_path=path_2,
    mean_speed=Slider(5.5, range=0..10),
    speed_std=Slider(2.1, range=0..10))  # -> out, Agent_Geo, sim_active; inputs run: Boolean, reset: Boolean, boundary_crv: Curve, obstacles_crvs: list of Curve, start_crvs: list of Curve, exit_crvs: list of Curve, num_agents: Int32, trajectory_file_path: String, mean_speed: Double, speed_std: Double
# ---------- py3_2: Python ----------
# -*- coding: utf-8 -*-
# Final, robust script for trigger-based simulation in Grasshopper
import shapely as sp
import scriptcontext as sc
import Rhino.Geometry as rg
from shapely.geometry import Polygon
from shapely.geometry import Point
import jupedsim as jps
from numpy.random import normal
import pathlib
import random as rnd

# ==============================================================================
# Helper Functions
# ==============================================================================

def curve_to_polygon(crv):
    """Converts a closed Rhino Curve to a shapely Polygon."""
    if not crv or not crv.IsClosed: return None
    res, polyline = crv.TryGetPolyline()
    if not res: return None
    return Polygon([(pt.X, pt.Y) for pt in polyline])

def poly_to_rhino_surface(polygon):
    """Converts a shapely Polygon (with potential holes) to Rhino Breps."""
    if not polygon: return None
    outer_crv = rg.Polyline([rg.Point3d(x, y, 0) for x, y in polygon.exterior.coords]).ToNurbsCurve()
    inner_crvs = [rg.Polyline([rg.Point3d(x, y, 0) for x, y in interior.coords]).ToNurbsCurve() for interior in polygon.interiors]
    breps = rg.Brep.CreatePlanarBreps([outer_crv] + inner_crvs, 0.01)
    return list(breps) if breps else []

models = [jps.CollisionFreeSpeedModel,jps.AnticipationVelocityModel,jps.SocialForceModel]

# ==============================================================================
# Main Script Logic
# ==============================================================================

# --- Handle Reset ---
# This has priority and will clear the simulation state.
if reset and 'sim_instance' in sc.sticky:
    sc.sticky.pop('sim_instance')
    print("Simulation Reset.")

# --- Handle Initialization ---
# This runs only once when 'run' is True and no simulation exists.
if run and 'sim_instance' not in sc.sticky:
    print("Initializing simulation...")
    
    # Input validation
    if all([boundary_crv, start_crvs, exit_crvs, trajectory_file_path]):
        # Geometry conversion
        area = curve_to_polygon(boundary_crv)
        obstacles = [curve_to_polygon(obstacle) for obstacle in obstacles_crvs]

        all_obstacles = sp.unary_union(obstacles).buffer(0.01)
        area = area.buffer(-0.01).difference(all_obstacles)

        spawning_areas = [curve_to_polygon(crv) for crv in start_crvs]
        exit_areas = [curve_to_polygon(crv) for crv in exit_crvs]
        
        if all([area, spawning_areas, exit_areas]):
            # Simulation setup
            traj_path = pathlib.Path(trajectory_file_path)
            traj_path.parent.mkdir(parents=True, exist_ok=True)

            model = jps.CollisionFreeSpeedModelV2()
            
            simulation = jps.Simulation(
                model=model, geometry=area,
                trajectory_writer=jps.SqliteTrajectoryWriter(output_file=traj_path)
            )
            
            # Collect ID of all exits---
            # 1. exit_id -> exit_polygon: 从出口ID找到其几何体，用于计算距离
            # 2. exit_id -> journey_id: 从出口ID找到通往它的行程ID
            exit_to_poly_map = {}
            exit_to_journey_map = {}

            for exit_poly in exit_areas:
                # 为每个出口多边形创建一个 stage，并获取其ID
                exit_id = simulation.add_exit_stage(exit_poly.exterior.coords[:-1])
                # 创建一个只包含这一个出口ID的行程
                journey = jps.JourneyDescription([exit_id])
                journey_id = simulation.add_journey(journey)
                
                # 填充我们的查找字典
                exit_to_poly_map[exit_id] = exit_poly
                exit_to_journey_map[exit_id] = journey_id

            # Create ppl in all spawning areas
            all_positions = []
            all_speeds = []
            total_area = sum(p.area for p in spawning_areas)
            agents_created = 0

            for i, poly in enumerate(spawning_areas):
                if total_area > 0:
                    ratio = poly.area / total_area
                    if i == len(spawning_areas) - 1:
                        agents_for_this_poly = num_agents - agents_created
                    else:
                        agents_for_this_poly = int(round(num_agents * ratio))
                else: 
                    agents_for_this_poly = num_agents // len(spawning_areas)
                
                if agents_for_this_poly <= 0: continue

                # Positions
                positions = jps.distributions.distribute_by_number(
                    polygon=poly, number_of_agents=agents_for_this_poly,
                    distance_to_agents=0.2, distance_to_polygon=0.2, seed=i # use different seed
                )
                speeds = normal(mean_speed, speed_std, len(positions))
                
                all_positions.extend(positions)
                all_speeds.extend(speeds)
                agents_created += len(positions)
            
            print("Total agents created: {}".format(len(all_positions)))
            
            #parameter
            #add all agents into simulation

            # 一次性将所有收集到的行人添加到模拟中
            for pos, v0 in zip(all_positions, all_speeds):
                
                # 1. 创建当前行人位置的Shapely点对象
                agent_point = Point(pos)
                
                # 2. Calculate all the points to exit
                # min() to find the smallest key
                closest_exit_id = min(
                    exit_to_poly_map.keys(),
                    key=lambda exit_id: agent_point.distance(exit_to_poly_map[exit_id])
                )
                
                # 3. find the shortest journey from dictionary
                assigned_journey_id = exit_to_journey_map[closest_exit_id]
                
                # 4. Add agent to simu, distribute journey 
                simulation.add_agent(
                    jps.CollisionFreeSpeedModelV2AgentParameters(
                        journey_id=assigned_journey_id,
                        stage_id=closest_exit_id, #stage ID is the closet one
                        position=pos,
                        desired_speed=v0,
                    )
                )

            sc.sticky['sim_instance'] = simulation
            print("Initialization complete.")

# --- Initialize outputs for this run ---
Agent_Geo = []
sim_active = False
out = "Idle."

# --- Main simulation and output logic ---
simulation = sc.sticky.get('sim_instance')

if simulation:
    if simulation.agent_count() > 0:
        if run:
            simulation.iterate()
        
        agents = simulation.agents()
        Agent_Geo = [rg.Point3d(agent.position[0], agent.position[1], 0) for agent in agents]
        
        status = "Running" if run else "Paused"
        out = "{} | Step: {} | Agents: {}".format(status, simulation.iteration_count(), simulation.agent_count())
        sim_active = True
        
        if run and simulation.agent_count() == 0:
            out = "Simulation Complete! | Steps: {} To run again, set 'run' to False, then back to True.".format(simulation.iteration_count())
            sim_active = False
    else:
        out = "Simulation Complete! Press 'reset' to start over."
        sim_active = False
        if 'sim_instance' in sc.sticky:
            sc.sticky.pop('sim_instance')
else:
    out = "Ready. Set 'run' to True to initialize."
# ---------- end py3_2 ----------
panel = Panel(py3.sim_active)  # disabled
srf = Surface(py3.Area_Geo)  # disabled
pt = Point(py3.Agent_Geo)  # disabled
panel_2 = Panel(py3_2.sim_active)
panel_3 = Panel(py3.out)  # disabled
panel_4 = Panel(py3_2.out)
srf_2 = Surface(crv)
srf_3 = Surface(crv_6)
srf_4 = Surface(crv_7)
pt_2 = Point(py3_2.Agent_Geo)
cir = Circle(Plane=pt, Radius=0.2)  # disabled
cir_2 = Circle(Plane=pt_2, Radius=0.2)
preview = CustomPreview(Geometry=srf_4, Material=ColourSwatch(SwatchColor=RGBA(5, 243, 0, 134)))
srf_5 = Surface(cir_2)
preview_2 = CustomPreview(Geometry=srf_2, Material=ColourSwatch(SwatchColor=RGBA(255, 0, 0, 127)))
Z = UnitZ(Factor=Slider(1.7, range=0..10))
extr = Extrude(Direction=Z)
